# Dynamo graph AVEAS_SolarRad.dyn "superposition_model" (Dynamo 2.10.1.3976)
# packages: Solar Analysis for Dynamo 1.12.0, spring nodes 204.1.0

# note: The PV panel family faces north, these nodes simply flip all panels so they face due south

grid_size_for_solar_analysis_ft = CodeBlock { 3.28084; }
code_block = CodeBlock { impact_width_m=25; impact_length_m=37; }
code_block_2 = CodeBlock(gSpace=grid_size_for_solar_analysis_ft, impact_width_m=code_block.impact_width_m, impact_length_m=code_block.impact_length_m) { impact_width=gSpace*impact_width_m; impact_length=gSpace*impact_length_m; }
set_point_for_solar_panel = CodeBlock(gSpacing=grid_size_for_solar_analysis_ft, impact_length=code_block_2.impact_length) { origin_y=3*gSpacing; origin_x=impact_length/2; }
categories = Categories("OST_Roofs")
siteLocation = SiteLocation()
byLocation = DynamoSolarAnalysis.Weather.Weather.ByLocation(location=siteLocation)
code_block_3 = CodeBlock()
# ---------- code_block_3.designscript (2 lines) ----------
//year
2020;
# ----------------------------------------

# group: This section contains all user altered input parameters
code_block_4 = CodeBlock()
# ---------- code_block_4.designscript (9 lines) ----------
//start month
10;
//Start day
01;

//end month
12;
//end day
31;
# ----------------------------------------
pv_panel_clearance_height = DoubleSlider(14, range=0..30 step 1)
pv_panel_tilt = DoubleSlider(25, range=0..90 step 1)
file_directory = CodeBlock { "C:\\Users\\proctork\\Documents\\Graduate_School\\Research\\Thesis\\Radiation_modeling\\Code\\Rad_out\\panel_clearance_height\\14_feet\\"; }
code_block_5 = CodeBlock { crop_file_name="crop_SP_"; PV_file_name="PVout_SP_"; param_file_name="model_parameters_SP_"; file_num="_01"; }

python_script = Python(IN[0]=code_block_3, IN[1]=code_block_4.out0, IN[2]=code_block_4.out1, IN[3]=code_block_4.out2, IN[4]=code_block_4.out3)  # CPython3
# ---------- python_script.python (65 lines) ----------
# Load the Python Standard and DesignScript Libraries
import sys
import clr
clr.AddReference('ProtoGeometry')
from Autodesk.DesignScript.Geometry import *
import datetime
sys.path.append(r'C:\Users\proctork\Anaconda3\envs\Dynamo383\Lib\site-packages')
import numpy as np

##This node creates the list of datetimes that will be used to develop
## The time study for the solar analysis node
## It creates a list containing 4 series
## 1) Hourly start dates 2) Hourly End Dates 3) Daily Start Dates 4) Daily End Dates 

## to make this work you need numpy
## follow instructions at this link
## https://forum.dynamobim.com/t/how-to-install-python-modules-in-dynamo-core-runtime-2-8-0/52922/8

# The inputs to this node will be stored as a list in the IN variables.
yr= IN[0]
m_strt = IN[1]
d_strt = IN[2]
m_end = IN[3]
d_end = IN[4]
# Place your code below this line
#day_list=range(d_strt,d_end,1)
t_strt=datetime.datetime(yr,m_strt,d_strt)
t_end=datetime.datetime(yr,m_end,d_end)
jday_strt=t_strt.timetuple().tm_yday
jday_end=t_end.timetuple().tm_yday

timeSpan=[]
timeSpan_days_S=[]
timeSpan_days_E=[]
hrs=np.arange(4,22,1)
if jday_strt==jday_end: #single day analysis
    
    
    for i in hrs:
        tStamp_str=str(yr)+', '+str(jday_strt)+', '+str(i).zfill(2)+', 30'
        tStamp_dt=datetime.datetime.strptime(tStamp_str, '%Y, %j, %H, %M' )
        timeSpan.append(tStamp_dt)
        if i==hrs[0]: 
            timeSpan_days_S.append(tStamp_dt)
        if i==hrs[-1]:
            timeSpan_days_E.append(tStamp_dt)
else: 
    jday_range=np.arange(jday_strt,jday_end,1)
    for j in jday_range:
        for i in hrs:
            tStamp_str=str(yr)+', '+str(j)+', '+str(i).zfill(2)+', 30'
            tStamp_dt=datetime.datetime.strptime(tStamp_str, '%Y, %j, %H, %M' )
            timeSpan.append(tStamp_dt)
            if i==hrs[0]: 
                timeSpan_days_S.append(tStamp_dt)
            if i==hrs[-1]:
                timeSpan_days_E.append(tStamp_dt)
                

start_list=timeSpan[:-1]
stop_list=timeSpan[1:]

#timeSpan
# Assign your output to the OUT variable.
OUT = [start_list,stop_list,timeSpan_days_S,timeSpan_days_E]
# ----------------------------------------
string_from_object = FromObject(object=python_script)
code_block_6 = CodeBlock(dates_as_str=string_from_object)
# ---------- code_block_6.designscript (15 lines) ----------
dates_as_dt = DateTime.FromString(dates_as_str);
tRange = dates_as_dt;
t0 = Get.ValueAtIndex(tRange, 0);
t1 = Get.ValueAtIndex(tRange, 1);
td0 = Get.ValueAtIndex(tRange, 2);
td1 = Get.ValueAtIndex(tRange, 3);
timestudyPV = TimeStudy.FromStartTimeToEndTime(td0, td1, "False");
timestudyCrp = TimeStudy.FromStartTimeToEndTime(t0, t1, "False");
count_Crp = List.Count(t0);
count_PV = List.Count(td1);
tRangeS = dates_as_str;
tR0 = Get.ValueAtIndex(tRangeS, 0);
tR1 = Get.ValueAtIndex(tRangeS, 1);
tRd0 = Get.ValueAtIndex(tRangeS, 2);
TRd1 = Get.ValueAtIndex(tRangeS, 3);
# ----------------------------------------
roof_types = RoofTypes("Generic - 12\"")
levels = Levels("Level 1")
create_ground_area_used_for_crop = CodeBlock(impact_l=code_block_2.impact_length, impact_w=code_block_2.impact_width, roof_type=roof_types, level=levels)  # "Create ground area used for crop level solar radiation analysis (as a roof)"
# ---------- create_ground_area_used_for_crop.designscript (24 lines) ----------
impact_length = impact_l;
impact_width = impact_w;
x1 = 0;
x2 = impact_length;
y1 = 0;
y2 = impact_width;
"Create 4 points based on coordinates";
point1 = Autodesk.Point.ByCoordinates(x1, y1);
point2 = Autodesk.Point.ByCoordinates(x2, y1);
point3 = Autodesk.Point.ByCoordinates(x2, y2);
point4 = Autodesk.Point.ByCoordinates(x1, y2);
point_list = List.Join([point1, point2, point3, point4]);
"Create poly curve based on points";

polyCurve1 = PolyCurve.ByPoints(point_list, "True");

"Create a roof based on polycurve at level 1";
roof1 = Roof.ByOutlineTypeAndLevel(polyCurve1, roof_type, level);
"The roof has a thickness of 0.1 feet, the next line moves the roof down";
"By 0.1 feet so that the surface of the roof is at ground level";
element1 = Revit.Element.SetParameterByName(roof1, "Base Offset From Level", -0.1);
"extract faces of roof, only need top surface for solar analysis";
surface1 = Revit.Element.Faces(element1);
top_surface=surface1[1];
# ----------------------------------------
length_meters = DoubleSlider(6, range=1..50 step 1)
width_meters = DoubleSlider(2, range=0..5 step 1)
convert_panel_size_to_feet = CodeBlock(length_m=length_meters, gSpacing=grid_size_for_solar_analysis_ft, width_m=width_meters) { length_ft=length_m*gSpacing; width_ft=width_m*gSpacing; }
latitude = DynamoUnits.Location.Latitude(location=siteLocation)
longitude = DynamoUnits.Location.Longitude(location=siteLocation)
ꟿ_number_tostring = Custom[ꟿ Number.ToString](num=pv_panel_clearance_height)  # package spring nodes; Converts the input number(s) to string. You can optionally limit the number of digits.
code_block_7 = CodeBlock(dir=file_directory, crop_file_name=code_block_5.crop_file_name, height=ꟿ_number_tostring, start=code_block_4.out0, end=code_block_4.out2, PV_file_name=code_block_5.PV_file_name, param_file_name=code_block_5.param_file_name)
# ---------- code_block_7.designscript (3 lines) ----------
crop_file=dir+crop_file_name+"h-"+height+"_t_"+start+"-"+end+".csv";
PV_file=dir+PV_file_name+"h-"+height+"_t_"+start+"-"+end+".csv";
param_file=dir+param_file_name+"h-"+height+"_t_"+start+"-"+end+".csv";
# ----------------------------------------
length = DoubleSlider(19.5, range=6.5..65 step 6.5)
width = DoubleSlider(7, range=3.5..35 step 3.5)
code_block_8 = CodeBlock(clearance=pv_panel_clearance_height, p_width=convert_panel_size_to_feet.width_ft, p_tilt=pv_panel_tilt) { pole_height=clearance+(p_width/2)*Math.Sin(p_tilt); }

# group: These nodes extract and alter the PV panel parameters
family_types = FamilyTypes("PV_Panel_test_parameterized:PV_Panel_test_parameterized")
code_block_9 = CodeBlock(family_type=family_types, width=convert_panel_size_to_feet.length_ft, length=convert_panel_size_to_feet.width_ft, tilt=pv_panel_tilt, height=code_block_8)
# ---------- code_block_9.designscript (4 lines) ----------
p_length = Revit.Element.SetParameterByName(family_type, "Panel Length", width);
p_width = Revit.Element.SetParameterByName(family_type, "Panel Width", length);
p_tilt = Revit.Element.SetParameterByName(family_type, "Panel Angle", tilt);
p_height = Revit.Element.SetParameterByName(family_type, "Panel Height", height);
# ----------------------------------------

create_pv_panel_at_origin_point = CodeBlock(x_point=set_point_for_solar_panel.origin_x, y_point=set_point_for_solar_panel.origin_y, family=family_types)  # "Create PV panel at origin point, rotate panel 180 degrees so it faces south, extract surfaces"
# ---------- create_pv_panel_at_origin_point.designscript (7 lines) ----------
origin_x = x_point;
origin_y = y_point;
family_type = family;
origin_point = Autodesk.Point.ByCoordinates(origin_x, origin_y);
familyinstance = Revit.FamilyInstance.ByPoint(family_type, origin_point);
familyinstance_rotated = Revit.FamilyInstance.SetRotation(familyinstance, 180);
PV_surfaces = Revit.Element.Faces(familyinstance_rotated);
# ----------------------------------------
get_pv_panel_top_face_python = Python(IN[0]=create_pv_panel_at_origin_point.PV_surfaces, IN[1]=categories)  # "Get PV panel top face(Python Script)"; CPython3
# ---------- get_pv_panel_top_face_python.python (47 lines) ----------
# Load the Python Standard and DesignScript Libraries
import sys
import clr
import Revit
clr.AddReference('ProtoGeometry')
from Autodesk.DesignScript.Geometry import *
clr.ImportExtensions(Revit.Elements)
clr.ImportExtensions(Revit.GeometryConversion)
clr.AddReference("RevitNodes")
clr.AddReference("RevitAPI")
clr.AddReference("RevitAPIUI")
clr.AddReference("RevitServices")

import RevitServices

from RevitServices.Persistence import DocumentManager
from RevitServices.Transactions import TransactionManager

from Autodesk.Revit.DB import*
from Autodesk.Revit.UI import*

clr.AddReference("DSCoreNodes")
import DSCore
from DSCore import *
#"""
# The inputs to this node will be stored as a list in the IN variables.
a = IN[0] # Faces of all solar panels
cat=IN[1] # sets category of directshape to roof
#num_column_panel=len(a) # number of panel columns
#num_row_panel=len(a[0]) # number of panel rows
top_face = 9 # for this particular panel config
             # the relevant face, is 9. This will vary by panel
             # Bifacial panels would have two faces 
mat=Revit.Elements.DirectShape.DynamoPreviewMaterial

pv_faces=[]

# Place your code below this line

face=a[top_face]
#face_x=Revit.Elements.DirectShape.ByGeometry(face,cat,mat,"DirectShape")
#pv_faces.append(face_x)
#"""

# Assign your output to the OUT variable.
OUT = face#pv_faces
#OUT= dir(Revit.Elements)
# ----------------------------------------
analyze = DynamoSolarAnalysis.Analysis.SolarAnalysis.Analyze(weather=byLocation, analysisSurfaces=get_pv_panel_top_face_python, shadingSurfaces=create_pv_panel_at_origin_point.PV_surfaces, timeStudy=code_block_6.timestudyPV, spacing=grid_size_for_solar_analysis_ft)

# group: Visualize Solar Energy (PV)
code_block_10 = CodeBlock()
# ---------- code_block_10.designscript (5 lines) ----------
colormax=Color.ByARGB(255,255,255,50);
colormid=Color.ByARGB(255,255,107,64);
colormin=Color.ByARGB(255,136,128,128);
colors=[colormin,colormid,colormax];
indices=[0,0.5,1];
# ----------------------------------------
flatten = List.Flatten(list=analyze.Cumulative)  # frozen
minimumItem = List.MinimumItem(list=flatten)
maximumItem = List.MaximumItem(list=flatten)
max = Math.Max(value1=minimumItem, value2=analyze.Cumulative)
code_block_11 = CodeBlock(min=minimumItem, max=maximumItem, n=max) { min==max ? 0.5 : (n-min)/(max-min); }
color_range = ColorRange(colors=code_block_10.colors, indices=code_block_10.indices, value=code_block_11)
bySurfaceColors = Modifiers.GeometryColor.BySurfaceColors(surface=get_pv_panel_top_face_python, colors=color_range)

analyze_2 = DynamoSolarAnalysis.Analysis.SolarAnalysis.Analyze(weather=byLocation, analysisSurfaces=create_ground_area_used_for_crop.top_surface, shadingSurfaces=create_pv_panel_at_origin_point.PV_surfaces, timeStudy=code_block_6.timestudyCrp, spacing=grid_size_for_solar_analysis_ft)

# group: Visualize Solar Energy (Crops)
code_block_12 = CodeBlock()  # same code as code_block_10
flatten_2 = List.Flatten(list=analyze_2.Cumulative)  # frozen
minimumItem_2 = List.MinimumItem(list=flatten_2)
maximumItem_2 = List.MaximumItem(list=flatten_2)
max_2 = Math.Max(value1=minimumItem_2, value2=analyze_2.Cumulative)
code_block_13 = CodeBlock(min=minimumItem_2, max=maximumItem_2, n=max_2) { min==max ? 0.5 : (n-min)/(max-min); }
color_range_2 = ColorRange(colors=code_block_12.colors, indices=code_block_12.indices, value=code_block_13)
bySurfaceColors_2 = Modifiers.GeometryColor.BySurfaceColors(surface=create_ground_area_used_for_crop.surface1, colors=color_range_2)

code_block_14 = CodeBlock(surface=get_pv_panel_top_face_python) { surface_area = Surface.Area(surface); SA = List.Flatten(surface_area, -1); }
code_block_15 = CodeBlock(panel_length=convert_panel_size_to_feet.length_ft, panel_width=convert_panel_size_to_feet.width_ft, panel_height=pv_panel_clearance_height, panel_tilt=pv_panel_tilt, impact_x=code_block_2.impact_length, impact_y=code_block_2.impact_width, area=code_block_14.SA, spacing=grid_size_for_solar_analysis_ft, origin_y=set_point_for_solar_panel.origin_y, Lat=latitude, Lon=longitude)
# ---------- code_block_15.designscript (2 lines) ----------
columns="Panel length (feet),Panel width (feet),Panel height (feet),Panel tilt (degree),Panel rad impact X(feet),Panel rad impact Y(feet),PV panel area (ft^2),Grid spacing(feet),Origin_y(feet),Lat,Lon";
panel_length+","+panel_width+","+panel_height+","+panel_tilt+","+impact_x+","+impact_y+","+area+","+spacing+","+origin_y+","+Lat+","+Lon;
# ----------------------------------------
code_block_16 = CodeBlock(column_headers=code_block_15.columns, data=code_block_15.out1, file_path=code_block_7.param_file) { output = List.Join([column_headers, data]); t4 = DSOffice.Data.ExportCSV(file_path, output); }
code_block_17 = CodeBlock(calcPoints=analyze_2.Calculation_Points) { x = Autodesk.Point.X(calcPoints); y = Autodesk.Point.Y(calcPoints); }
python_script_2 = Python(IN[0]=analyze_2.Cumulative, IN[1]=code_block_17.x, IN[2]=code_block_17.y, IN[3]=code_block_6.count_Crp, IN[4]=code_block_6.t0, IN[5]=code_block_6.t1)  # CPython3
# ---------- python_script_2.python (35 lines) ----------
# Load the Python Standard and DesignScript Libraries
import sys
import clr
clr.AddReference('ProtoGeometry')
from Autodesk.DesignScript.Geometry import *

sys.path.append(r'C:\Users\proctork\Anaconda3\envs\Dynamo383\Lib\site-packages')

import numpy as np

# The inputs to this node will be stored as a list in the IN variables.
s = IN[0]
x= IN[1]
y= IN[2]
num_hour= IN[3]
tR0= IN[4]
tR1= IN[5]

# Place your code below this line
row_per_time=int(np.array(s[0]).size)
t0Data=np.zeros((row_per_time*num_hour,1),dtype=object)
t1Data=np.zeros((row_per_time*num_hour,1),dtype=object)


for i in range(num_hour):
  
    
    cc=i+1
    t0Data[i*row_per_time:(cc)*row_per_time]=tR0[i]
    t1Data[i*row_per_time:(cc)*row_per_time]=tR1[i]

    
# Assign your output to the OUT variable.

OUT = [t0Data,t1Data,x,y,s]
# ----------------------------------------
code_block_18 = CodeBlock(output=python_script_2)
# ---------- code_block_18.designscript (14 lines) ----------
array = output;
t0 = Get.ValueAtIndex(array, 0);
t1 = Get.ValueAtIndex(array, 1);
x = Get.ValueAtIndex(array, 2);
y = Get.ValueAtIndex(array, 3);
solar = Get.ValueAtIndex(array, 4);
t0f = List.Flatten(t0, -1);
t1f = List.Flatten(t1, -1);
xf = List.Flatten(x, -1);
yf = List.Flatten(y, -1);
sf = List.Flatten(solar, -1);

columns="Start Time,Stop Time,X coordinate (feet),Y coordinate (feet),Cumulative Solar radiation (Kwh/m^2)";
t0f+","+t1f+","+xf+","+yf+","+sf;
# ----------------------------------------
code_block_19 = CodeBlock(column_names=code_block_18.columns, data=code_block_18.out12, file_path=code_block_7.crop_file) { out = List.Join([column_names, data]); csv = DSOffice.Data.ExportCSV(file_path, out); }
count_of_output_rows_pv = CodeBlock(radCumul=analyze.Cumulative) { radCumul_flat = List.Flatten(radCumul, -1); row_count = List.Count(radCumul_flat); }
extract_start_and_end_hour = Python(IN[0]=count_of_output_rows_pv.row_count, IN[1]=code_block_6.count_PV, IN[2]=code_block_6.tRd0, IN[3]=code_block_6.TRd1)  # "Extract Start and End hour values for output file"; CPython3
# ---------- extract_start_and_end_hour.python (25 lines) ----------
# Load the Python Standard and DesignScript Libraries
import sys
import clr
clr.AddReference('ProtoGeometry')
from Autodesk.DesignScript.Geometry import *

sys.path.append(r'C:\Users\proctork\Anaconda3\envs\Dynamo383\Lib\site-packages')

import numpy as np

# The inputs to this node will be stored as a list in the IN variables.
row_count = IN[0]
hour_count = IN[1]
tR0 = IN[2]
tR1 = IN[3]
# Place your code below this line
row_per_time=int(row_count/hour_count)
t0Data=np.zeros((row_count,1),dtype=object)
t1Data=np.zeros((row_count,1),dtype=object)
for i in range(0,hour_count):
    t0Data[i*row_per_time:(i+1)*row_per_time]=tR0[i]
    t1Data[i*row_per_time:(i+1)*row_per_time]=tR1[i]
    
# Assign your output to the OUT variable.
OUT = [t0Data,t1Data]
# ----------------------------------------
code_block_20 = CodeBlock(time_ranges=extract_start_and_end_hour)
# ---------- code_block_20.designscript (5 lines) ----------
tr = time_ranges;
tR0 = Get.ValueAtIndex(tr, 0);
tR1 = Get.ValueAtIndex(tr, 1);
tRf = List.Flatten(tR0, -1);
tR0f = List.Flatten(tR1, -1);
# ----------------------------------------
code_block_21 = CodeBlock(calc_points=analyze.Calculation_Points, radCumulative=analyze.Cumulative, t0=code_block_20.tRf, t1=code_block_20.tR0f)
# ---------- code_block_21.designscript (9 lines) ----------
points = List.Flatten(calc_points, -1);
x = List.Flatten(Autodesk.Point.X(calc_points),-1);
y = List.Flatten(Autodesk.Point.Y(calc_points),-1);
z = List.Flatten(Autodesk.Point.Z(calc_points),-1);

solar= List.Flatten(radCumulative, -1);

columns="Start Time,Stop Time,X coordinate (feet),Y coordinate (feet),Z coordinate (feet),Cumulative Solar radiation (Kwh/m^2)";
t0+','+t1+','+x+','+y+','+z+','+solar;
# ----------------------------------------
code_block_22 = CodeBlock(column_names=code_block_21.columns, data=code_block_21.out6, filepath=code_block_7.PV_file) { out = List.Join([column_names, data]); csv = DSOffice.Data.ExportCSV(filepath, out); }
watch = Watch(code_block_9.p_length)
watch_2 = Watch(code_block_9.p_width)
watch_3 = Watch(code_block_9.p_height)
watch_4 = Watch(code_block_9.p_tilt)
watch_5 = Watch(code_block_7.param_file)
code_block_23 = CodeBlock {  }
